# Grasshopper definition boolean_operations.gh (Grasshopper 0.9.80)
# plug-ins: dotsdev

crv = Curve(<curve referenced from the Rhino model>)
crv_2 = Curve(<curve referenced from the Rhino model>)
bool = BooleanOperations(CurveA=crv_2, CurveB=crv)  # -> Union, Intersection, Difference
crv_3 = Curve(<curve referenced from the Rhino model>)
crv_4 = Curve(<curve referenced from the Rhino model>)
Z = UnitZ(Factor=Slider(18.072, range=0..100))
bool_2 = BooleanOperations(CurveA=crv_4, CurveB=crv_3)  # -> Union, Intersection, Difference
move = Move(Geometry=bool.Union, Motion=Z)  # -> Geometry, Transform
Z_2 = UnitZ(Factor=Slider(18.072, range=0..100))
move_2 = Move(Geometry=bool_2.Union, Motion=Z_2)  # -> Geometry, Transform
Z_3 = UnitZ(Factor=Slider(8.893, range=0..100))
move_3 = Move(Geometry=bool.Difference, Motion=Z_3)  # -> Geometry, Transform
Z_4 = UnitZ(Factor=Slider(41.02, range=0..100))
Z_5 = UnitZ(Factor=Slider(8.893, range=0..100))
move_4 = Move(Geometry=bool.Intersection, Motion=Z_4)  # -> Geometry, Transform
move_5 = Move(Geometry=bool_2.Difference, Motion=Z_5)  # -> Geometry, Transform
Z_6 = UnitZ(Factor=Slider(41.02, range=0..100))
move_6 = Move(Geometry=bool_2.Intersection, Motion=Z_6)  # -> Geometry, Transform
