# Grasshopper definition important_source_code_gh_c3.gh (Grasshopper 0.9.76)

# ---- group: Random Generator
c_random_gen = CSharpScript(seed=Slider(7, range=0..10))  # -> out, A; inputs seed: Int32; disabled
# ---------- c_random_gen: C# ----------
    Random myRndGen = new Random(seed);
    double myRndDbl = myRndGen.NextDouble();
    Print(myRndDbl.ToString());

    int myRndInt = myRndGen.Next();
    Print(myRndInt.ToString());

    int myRndInt2 = myRndGen.Next(10, 20);
    Print(myRndInt2.ToString());


    for(int i = 0; i < 10; i++){
      Print(myRndGen.Next(0, 100).ToString());
    }

    List<Point3d> ptList = new List<Point3d>();
    double max = 200;
    for(int i = 0; i < 200; i++){
      double x = (myRndGen.NextDouble() * 2*max - max);
      double y = (myRndGen.NextDouble() * 2*max - max);
      double z = (myRndGen.NextDouble() * 2*max - max);
      Point3d pts = new Point3d(x, y, z);
      ptList.Add(pts);
    }

    A = ptList;
# ---------- end c_random_gen ----------
panel = Panel(c_random_gen.out)

# ---- group: Loop circle relaxation
c_script = CSharpScript(iCount=Slider(200, range=0..200), rad=Slider(2.048, range=0..100))  # -> out, A; inputs iCount: Int32, rad: Double
# ---------- c_script: C# ----------
    List<Point3d> ptLi = new List<Point3d>();
    for(int i = 0; i < iCount; i++){
      double x = rnd.NextDouble() * 2*rad - rad;
      double y = rnd.NextDouble() * 2*rad - rad;
      ptLi.Add(new Point3d(x, y, 0));
    }
    A = ptLi;
# ---------- c_script: C# additional code ----------
  Random rnd = new Random();
# ---------- end c_script ----------
c_circle_relaxation = CSharpScript(iStartingPositions=c_script.A, iReset=Toggle(False), iterationCount=Slider(1000, range=0..1000))  # -> out, outputGeometry; inputs iStartingPositions: list of Point3d, iterationCount: Int32; disabled
# ---------- c_circle_relaxation: C# ----------
    List<Point3d> centers = new List<Point3d>(iStartingPositions); //copy the list of initial points
    Print(centers.Count.ToString());

    for(int iteration = 0; iteration < iterationCount; iteration++){ //main for loop
      List<Vector3d> totalMoves = new List<Vector3d>();
      List<double> collisionCounts = new List<double>();

      double collisionDistance = 2.0;
      
      for(int i = 0; i < centers.Count; i++){ // 2nd for loop
        totalMoves.Add(new Vector3d(0, 0, 0));
        collisionCounts.Add(0.0);
      }
      
      for(int i = 0; i < centers.Count; i++){ // 2nd for loop
        for(int j = i + 1; j < centers.Count; j++){
          double d = centers[i].DistanceTo(centers[j]);
          if(d > collisionDistance) {
            continue;
          }
          Vector3d move = centers[i] - centers[j];
          move.Unitize();
          move *= (0.5 * (collisionDistance - d));
          totalMoves[i] += move;
          totalMoves[j] -= move;
          collisionCounts[i] += 1.0;
          collisionCounts[j] += 1.0;
        }
      }
      for(int i = 0; i < centers.Count; i++){//2nd for loop
        if(collisionCounts[i] != 0){
          Vector3d avgMove = totalMoves[i] / collisionCounts[i];
          centers[i] += avgMove;
        }
      }
    }
    outputGeometry = centers;
# ---------- end c_circle_relaxation ----------
panel_2 = Panel(c_circle_relaxation.out)
cir = Circle(Plane=c_circle_relaxation.outputGeometry, Radius=1)

# ---- group: concept of persistent data
timer = Timer(TimerInterval=20, Target=c_persistent_var)
c_persistent_var = CSharpScript(iReset=Toggle(True))  # -> out, A; inputs iReset: Boolean; disabled
# ---------- c_persistent_var: C# ----------
    if(iReset == true) n = 0;
    else n += 1;
    
    A = new Point3d(n, n, 0);
    Print(n.ToString());
# ---------- c_persistent_var: C# additional code ----------
  int n = 0;
# ---------- end c_persistent_var ----------
panel_3 = Panel(c_persistent_var.out)

# ---- group: point animated movement
vec = VectorXYZ(XComponent=Slider(0.495, range=0..1), YComponent=Slider(0.702, range=0..1), ZComponent=0)  # -> Vector, Length
timer_2 = Timer(TimerInterval=20, Target=c_persistent_point)
c_persistent_point = CSharpScript(iReset=Toggle(True))  # -> out, A; inputs iReset: Boolean, iVelocity: Vector3d; disabled
# ---------- c_persistent_point: C# ----------
    if(iReset){
      pos = new Point3d(0, 0, 0);
      posLi = new List<Point3d>();

      for(int i = 0; i < 10; i++){
        posLi.Add(new Point3d(0, 0, 0));
      }
    }
    else{
      double x = rnd.NextDouble() - 0.5;
      double y = rnd.NextDouble() - 0.5;
      pos += new Vector3d(x, y, 0);
      posLi.Add(pos);
      posLi.RemoveAt(0);
    }
    A = posLi;
    //Print(position.X.ToString() + "," + position.Y.ToString());
# ---------- c_persistent_point: C# additional code ----------
  // global vars
  // common methods
  Point3d pos = new Point3d(0, 0, 0);
  Random rnd = new Random();

  List<Point3d> posLi = new List<Point3d>();
# ---------- end c_persistent_point ----------
panel_4 = Panel(c_persistent_point.A)
pline = PolyLine(Vertices=c_persistent_point.A, Closed=False)

# ---- group: curve to polyline decasteljsu
crv = Curve(reparameterize(<curve referenced from the Rhino model>))
c_subdiv_crv_poly = CSharpScript(curve=crv, tolerance=Slider(0.364, range=0.01..10))  # -> out, A; inputs curve: Curve, tolerance: Double; disabled
# ---------- c_subdiv_crv_poly: C# ----------
    List<LineCurve> segments = new List<LineCurve>();
    divideCurve(curve, 0.0, 1.0, tolerance, segments);
    A = segments;
# ---------- c_subdiv_crv_poly: C# additional code ----------
  void divideCurve(Curve crv, double tStart, double tEnd, double tolerance, List<LineCurve> segments){
    Point3d startPt = crv.PointAt(tStart);
    Point3d endPt = crv.PointAt(tEnd);
    Point3d midPt = 0.5 * (startPt + endPt);

    double tClosest;
    crv.ClosestPoint(midPt, out tClosest); // out => tClosest is automatically updated

    double di = crv.PointAt(tClosest).DistanceTo(midPt);
    if(di < tolerance){
      Print("counter-0");
      segments.Add(new LineCurve(startPt, endPt));
    }else{
      Print("counter-1");
      double tMid = 0.5 * (tStart + tEnd);
      divideCurve(crv, tStart, tMid, tolerance, segments);
      divideCurve(crv, tMid, tEnd, tolerance, segments);
    }
  }
# ---------- end c_subdiv_crv_poly ----------
Z = UnitZ(Factor=Slider(10, range=0..10))
move = Move(Geometry=c_subdiv_crv_poly.A, Motion=Z)  # -> Geometry, Transform
panel_5 = Panel(c_subdiv_crv_poly.out)

# ---- group: animated circle relaxation
c_script_2 = CSharpScript(iCount=Slider(191, range=0..200), rad=Slider(2.048, range=0..100))  # -> out, A; inputs iCount: Int32, rad: Double; same code as c_script
c_circle_relaxation_persistent = CSharpScript(iStartingPositions=c_script_2.A, iReset=Toggle(False))  # -> out, outputGeometry; inputs iStartingPositions: list of Point3d, iReset: Boolean; disabled
# ---------- c_circle_relaxation_persistent: C# ----------
   
    if(iReset){
      centers = new List<Point3d>(iStartingPositions); //copy the list of initial points
    }
    
    //for(int iteration = 0; iteration < iterationCount; iteration++){ //main for loop
      List<Vector3d> totalMoves = new List<Vector3d>();
      List<double> collisionCounts = new List<double>();

      double collisionDistance = 2.0;

      for(int i = 0; i < centers.Count; i++){ // 2nd for loop
        totalMoves.Add(new Vector3d(0, 0, 0));
        collisionCounts.Add(0.0);
      }

      for(int i = 0; i < centers.Count; i++){ // 2nd for loop
        for(int j = i + 1; j < centers.Count; j++){
          double d = centers[i].DistanceTo(centers[j]);
          if(d > collisionDistance) {
            continue;
          }
          Vector3d move = centers[i] - centers[j];
          move.Unitize();
          move *= (0.5 * (collisionDistance - d));
          totalMoves[i] += move;
          totalMoves[j] -= move;
          collisionCounts[i] += 1.0;
          collisionCounts[j] += 1.0;
        }
      }
      for(int i = 0; i < centers.Count; i++){//2nd for loop
        if(collisionCounts[i] != 0){
          Vector3d avgMove = totalMoves[i] / collisionCounts[i];
          centers[i] += avgMove;
        }
      }
    //}
    outputGeometry = centers;
# ---------- c_circle_relaxation_persistent: C# additional code ----------
 
  List<Point3d> centers=new List<Point3d>();//persistent centers at blank
# ---------- end c_circle_relaxation_persistent ----------
timer_3 = Timer(TimerInterval=20, Target=c_circle_relaxation_persistent)
cir_2 = Circle(Plane=c_circle_relaxation_persistent.outputGeometry, Radius=1)
panel_6 = Panel(c_circle_relaxation_persistent.out)

# ---- group: polyline
c_script_3 = CSharpScript()  # -> out, A
# ---------- c_script_3: C# ----------
    Point3d a = new Point3d(0, 0, 0);
    Point3d b = new Point3d(50, 0, 0);
    Point3d c = new Point3d(50, 50, 0);
    Point3d d = new Point3d(0, 50, 0);
    List<Point3d> pts = new List<Point3d>();
    pts.Add(a);
    pts.Add(b);
    pts.Add(c);
    pts.Add(d);
    pts.Add(a);
    Polyline poly = new Polyline(pts);
    A = poly;
# ---------- end c_script_3 ----------
move_2 = Move(Geometry=c_script_3.A, Motion=Vector(0, 0, 10))  # -> Geometry, Transform

# ---- group: OOP
c_script_4 = CSharpScript()  # -> out, A
# ---------- c_script_4: C# ----------
    Pyramid pyr = new Pyramid();
    pyr.BasePlane = Plane.WorldXY;
    pyr.Length = 1.2;
    pyr.Width = 3.4;
    pyr.Height = 5.6;

    Pyramid pyr2 = new Pyramid(Plane.WorldYZ, 2.2, 1.4, 2.7);
    Print(pyr2.ComputeVol().ToString());
# ---------- c_script_4: C# additional code ----------
  class Pyramid{
    public Plane BasePlane;
    public double Length;
    public double Width;
    public double Height;
    public Pyramid(){}
    public Pyramid(Plane plane, double l, double w, double h){
      BasePlane = plane;
      Length = l;
      Width = w;
      Height = h;
    }
    public double ComputeVol(){
      return 0.333 * Length * Width * Height;
    }
  }
# ---------- end c_script_4 ----------

# ---- group: Needs to completed - brain curve
crv_2 = Curve(reparameterize(<curve referenced from the Rhino model>))
rad = Slider(5.494, range=0..10)
c_subdiv_crv_poly_2 = CSharpScript(curve=crv_2, rad=rad, tolerance=Slider(0.569, range=0.01..10))  # -> out, outputSegments, outputCenPts, outputCircles; inputs curve: Curve, rad: Double, tolerance: Double
# ---------- c_subdiv_crv_poly_2: C# ----------
    List<LineCurve> segments = new List<LineCurve>();
    divideCurve(curve, 0.0, 1.0, tolerance, segments);
    List < Point3d > cenPts = new List<Point3d>();
    List<Circle> circles = new List<Circle>();

    for(int i = 0; i < segments.Count; i++){
      Point3d p = 0.5 * (segments[i].PointAt(0.0) + segments[i].PointAt(1.0));
      cenPts.Add(p);
      Circle c = new Circle(p, rad);
      circles.Add(c);
    }

    outputSegments = segments;
    outputCenPts = cenPts;
    outputCircles = circles;
# ---------- c_subdiv_crv_poly_2: C# additional code ----------
  void divideCurve(Curve crv, double tStart, double tEnd, double tolerance, List<LineCurve> segments){
    Point3d startPt = crv.PointAt(tStart);
    Point3d endPt = crv.PointAt(tEnd);
    Point3d midPt = 0.5 * (startPt + endPt);

    double tClosest;
    crv.ClosestPoint(midPt, out tClosest); // out => tClosest is automatically updated

    double di = crv.PointAt(tClosest).DistanceTo(midPt);
    if(di < tolerance){
      Print("counter-0");
      segments.Add(new LineCurve(startPt, endPt));
    }else{
      Print("counter-1");
      double tMid = 0.5 * (tStart + tEnd);
      divideCurve(crv, tStart, tMid, tolerance, segments);
      divideCurve(crv, tMid, tEnd, tolerance, segments);
    }
  }
# ---------- end c_subdiv_crv_poly_2 ----------
Z_2 = UnitZ(Factor=Slider(5.863, range=0..10))
panel_7 = Panel(c_subdiv_crv_poly_2.out)
move_3 = Move(
    Geometry=[c_subdiv_crv_poly_2.outputCenPts, c_subdiv_crv_poly_2.outputSegments, c_subdiv_crv_poly_2.outputCircles],
    Motion=Z_2)  # -> Geometry, Transform
