# Grasshopper definition spg2.gh (Grasshopper 0.9.80)
# plug-ins: dotsdev

path = FilePath("/Users/nirviksaha/Projects/inputs_for_dots/adj_inputs.csv")
path_2 = FilePath("/Users/nirviksaha/Projects/inputs_for_dots/geom_inputs.csv")
timer = Timer(TimerInterval=20, Target=inputs)
inputs = Dots_dev(FilePathAdjacency=path, FilePathGeometry=path_2)  # -> OutputAdjacency, OutputFunctions, DisplayLines
Z = UnitZ(Factor=1)
move = Move(Geometry=inputs.DisplayLines, Motion=Z)  # -> Geometry, Transform
panel = Panel(inputs.OutputFunctions)
